# Dynamo graph CP-GRADIENT ROTATION.dyn (Dynamo 2.19.3.6394)
# packages: archi-lab.net 2024.217.1024

select_curtain_panel = DSModelElementSelection()  # 1 picked in the model; graph input

# group: GRADIENT - VISIBILITY
byElement = CurtainPanel.ByElement(hostingElement=select_curtain_panel)
curtainGrid = archilab.Revit.Elements.Walls.CurtainGrid(wall=select_curtain_panel)
numVLines = archilab.Revit.Elements.CurtainGrids.NumVLines(curtainGrids=curtainGrid)
code_block = CodeBlock(a=numVLines) { a+1; }
chop = List.Chop(list=byElement, lengths=code_block)
transpose = List.Transpose(lists=chop)
code_block_2 = CodeBlock { 0; 1; }
code_block_3 = CodeBlock(s=code_block) { 0..s..1; }
numULines = archilab.Revit.Elements.CurtainGrids.NumULines(curtainGrids=curtainGrid)
remapRange = Math.RemapRange(numbers=code_block_3, newMax=numULines)
ceiling = Math.Ceiling(number=remapRange)
ofRepeatedItem = List.OfRepeatedItem(item=code_block_2.out0, amount=ceiling)
reverse = List.Reverse(list=ceiling)
ofRepeatedItem_2 = List.OfRepeatedItem(item=code_block_2.out1, amount=reverse)
list_create = List.Create(item0=ofRepeatedItem, item1=ofRepeatedItem_2)
transpose_2 = List.Transpose(lists=list_create)
flatten = List.Flatten(list=transpose_2@L3)
shuffle = List.Shuffle(list=flatten@L2)
takeItems = List.TakeItems(list=transpose@L1, amount=shuffle@L1)
code_block_4 = CodeBlock { "Rotation"; }
code_block_5 = CodeBlock { 45; }
setParameterByName = Element.SetParameterByName(element=takeItems, parameterName=code_block_4, value=code_block_5)
