# Dynamo graph CP-RANDOM ORBIT.dyn (Dynamo 2.19.3.6394)

select_curtain_panel = DSModelElementSelection()  # 1 picked in the model; graph input
byElement = CurtainPanel.ByElement(hostingElement=select_curtain_panel)
integer_slider = IntegerSlider(270, range=0..270 step 90)

# group: MIN MAX
integer_slider_2 = IntegerSlider(0, range=0..270 step 90)
integer_slider_3 = IntegerSlider(90, range=0..270 step 90)
integer_slider_4 = IntegerSlider(180, range=0..270 step 90)
list_create = List.Create(item0=integer_slider_2, item1=integer_slider_3, item2=integer_slider_4, item3=integer_slider)

count = List.Count(list=byElement)

# group: RANDOM
code_block = CodeBlock { "Orbit"; }
code_block_2 = CodeBlock(a=count) { a/2+1; }
cycle = List.Cycle(list=list_create, amount=code_block_2)
shuffle = List.Shuffle(list=cycle)
code_block_3 = CodeBlock(a=shuffle, b=count) { a[0..b-1]; }
setParameterByName = Element.SetParameterByName(element=byElement, parameterName=code_block, value=code_block_3)
